# Grasshopper definition krl.gh (Grasshopper 0.9.76)
# plug-ins: KUKA|prc - parametric robot control

path = FilePath("C:\Users\dmou8237\Downloads\blender-2.75a-windows64\blender-2.75a-windows64\krl.src")
krl = KUKAPrcImportKRLCode(Path=path)

# ---- group: Plane Output from KRL
extract_cmd = KUKAPrcExtractCommand(KUKAPrcCommand=krl)  # -> PlaneOutput, AxisValues

# ----
mesh = Mesh(<mesh referenced from the Rhino model>)
custom_tool = CustomToolForKUKAPrc(
    CustomToolGeometry=mesh,
    toolid=6,
    toolvala=0,
    toolvalb=0,
    toolvalc=0,
    toolvalx=0,
    toolvaly=0,
    toolvalz=810,
    valuesset=True)
kr_6_10_r1100 = KUKAAgilusKR6KR10R1100(highresactive=False)
kuka_prc = KUKAPrcCORE(
    SimulationSlider=Slider(1, range=0..1),
    KUKAPrcCommands=krl,
    KUKAPrcTool=custom_tool,
    KUKAPrcRobot=kr_6_10_r1100,
    SaveToggle=True,
    Filename="kprcgen",
    acc_cp=nan,
    acc_ptp=-1,
    basea=0,
    baseb=90,
    basec=0,
    baseindex=6,
    basex=1200,
    basey=0,
    basez=1000,
    camrobformatting="""&ACCESS RVP
&REL 1
&PARAM TEMPLATE = C:\KRC\Roboter\Template\vorgabe
&PARAM EDITMASK = *
[PROJECTNAME]

[SPLITDEFS]

;FOLD INI
;FOLD BASISTECH INI
GLOBAL INTERRUPT DECL 3 WHEN $STOPMESS==TRUE DO IR_STOPM ( )
INTERRUPT ON 3
BAS (#INITMOV,0 )
;ENDFOLD (BASISTECH INI)
;ENDFOLD (INI)

[STARTAXPOS]

[SETPARAMETERS]

[COMMANDS]

END""",
    camrobon=False,
    checkallcolls=False,
    enda01=0,
    enda02=-90,
    enda03=90,
    enda04=0,
    enda05=0,
    enda06=0,
    ende01=0,
    ende02=0,
    ende03=0,
    ende04=0,
    endindex=0,
    haltatend=False,
    hash=22428,
    initialstatus="110",
    int_advance=-1,
    int_cdis=nan,
    int_cori=nan,
    int_cptp=-1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)  # -> RobotGeometry, AnalysisOutput
